# Grasshopper definition Iterator2Testing.gh (Grasshopper 0.9.76)
# plug-ins: Colibri

ddd = Slider(10, range=0..10)
list = Panel("dddg")
wwr = Slider(0.484, range=0..1)
iterator = Iterator2(WwrnewInputs=wwr, Fly=Toggle(True))
panel = Panel(iterator)
